# Grasshopper definition Weather-Wall.gh (Grasshopper 0.9.76)
# plug-ins: Python Interpreter

ladybug = Ladybug_Ladybug()  # -> Vviiiiiiiiiizzz; plug-in component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

# ---- group: Weather File
panel = Panel("https://www.energyplus.net/weather-download/north_and_central_america_wmo_region_4/USA/CA/USA_CA_Burbank-Glendale-Passadena.Bob.Hope.AP.722880_TMY3/all")
downloadepw = Ladybug_downloadEPWWeatherFile(download=Toggle(False))  # -> readMe; plug-in component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
epw_stat = Ladybug_OpenEPWAndSTATWeatherFiles(weatherFileURL=panel)  # -> epwFile, statFile; plug-in component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
importepw = Ladybug_ImportEpw(epwFile=epw_stat.epwFile)  # -> readMe, latitude, location, dryBulbTemperature, dewPointTemperature, relativeHumidity, windSpeed, windDirection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; plug-in component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

panel_2 = Panel("https://www.energyplus.net/weather-download/north_and_central_america_wmo_region_4/USA/NY/USA_NY_New.York-J.F.Kennedy.Intl.AP.744860_TMY3/all")
downloadepw_2 = Ladybug_downloadEPWWeatherFile(download=Toggle(False))  # -> readMe; plug-in component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
epw_stat_2 = Ladybug_OpenEPWAndSTATWeatherFiles(weatherFileURL=panel_2)  # -> epwFile, statFile; plug-in component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
importepw_2 = Ladybug_ImportEpw(epwFile=epw_stat_2.epwFile)  # -> readMe, latitude, location, dryBulbTemperature, dewPointTemperature, relativeHumidity, windSpeed, windDirection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; plug-in component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

panel_3 = Panel("https://www.energyplus.net/weather-download/asia_wmo_region_2/IND//IND_Ahmedabad.426470_IWEC/all")
downloadepw_3 = Ladybug_downloadEPWWeatherFile(download=Toggle(False))  # -> readMe; plug-in component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
epw_stat_3 = Ladybug_OpenEPWAndSTATWeatherFiles(weatherFileURL=panel_3)  # -> epwFile, statFile; plug-in component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
importepw_3 = Ladybug_ImportEpw(epwFile=epw_stat_3.epwFile)  # -> readMe, latitude, location, dryBulbTemperature, dewPointTemperature, relativeHumidity, windSpeed, windDirection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; plug-in component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

panel_4 = Panel("https://www.energyplus.net/weather-download/asia_wmo_region_2/IND//IND_Ahmedabad.426470_IWEC/all")
downloadepw_4 = Ladybug_downloadEPWWeatherFile(download=Toggle(False))  # -> readMe; plug-in component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
epw_stat_4 = Ladybug_OpenEPWAndSTATWeatherFiles(weatherFileURL=panel_4)  # -> epwFile, statFile; plug-in component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
importepw_4 = Ladybug_ImportEpw(epwFile=epw_stat_4.epwFile)  # -> readMe, latitude, location, dryBulbTemperature, dewPointTemperature, relativeHumidity, windSpeed, windDirection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; plug-in component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

# ----
gradientlibrary = Ladybug_GradientLibrary()  # -> customColors; plug-in component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

# ---- group: 3D Chart
swatch = ColourSwatch(SwatchColor=RGB(255, 255, 255))
swatch_2 = ColourSwatch(SwatchColor=RGB(0, 0, 255))
legendpar = Ladybug_LegendParameters(lowBound="21", highBound="26", customColors=flatten([gradientlibrary, ColourSwatch(SwatchColor=RGB(255, 0, 0))]))  # -> legendPar; plug-in component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
panel_5 = Panel("21<a<26")
_3dchart = Ladybug_3DChart(inputData=flatten(importepw_3.dryBulbTemperature), basePoint="0,500,0", xScale="0.25", zScale="0", legendPar=legendpar)  # -> readMe, graphMesh, graphCurves, legend, legendBasePts, title, titleBasePts, dataPts, conditionalHOY; plug-in component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
preview = CustomPreview(Geometry=[_3dchart.legend, _3dchart.graphCurves], Shader=ColourSwatch(SwatchColor=RGB(0, 0, 0)))

legendpar_2 = Ladybug_LegendParameters(
    lowBound="21",
    highBound="26",
    customColors=flatten([ColourSwatch(SwatchColor=RGB(0, 0, 255)), ColourSwatch(SwatchColor=RGB(255, 255, 255)), ColourSwatch(SwatchColor=RGB(255, 0, 0))]))  # -> legendPar; plug-in component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
_3dchart_2 = Ladybug_3DChart(basePoint="0,500,0", xScale="0.25", zScale="0")  # -> readMe, graphMesh, graphCurves, legend, legendBasePts, title, titleBasePts, dataPts, conditionalHOY; plug-in component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
preview_2 = CustomPreview(Geometry=[_3dchart_2.legend, _3dchart_2.graphCurves], Shader=ColourSwatch(SwatchColor=RGB(0, 0, 0)))

# ---- group: Mannequin
comfortmannequin = Ladybug_ComfortMannequin(bodyPosture=Slider(0, range=0..2), rotationAngle=Slider(49, range=0..360))  # -> mannequinMesh, legend, legendBasePt; plug-in component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

# ---- group: Outdoor Comfort
outdoorcomfortcalculator = Ladybug_OutdoorComfortCalculator(
    dryBulbTemperature=Slider(24, range=0..30),
    windSpeed_tenMeters=Slider(3, range=0..5),
    relativeHumidity=Slider(74, range=0..100),
    runIt=Toggle(True))  # -> readMe, port, universalThermalClimateIndex, comfortableOrNot, thermalStress, conditionOfPerson, port_2, percentOfTimeComfortable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; plug-in component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
panel_7 = Panel(outdoorcomfortcalculator.universalThermalClimateIndex)

# ----
pmvcomfortcalculator = Ladybug_PMVComfortCalculator(
    dryBulbTemperature=Slider(28, range=0..30),
    relativeHumidity=Slider(42, range=0..100),
    clothingLevel=Slider(0, range=0..2),
    calcBalanceTemperature=False,
    runIt=Toggle(True))  # -> readMe, port, predictedMeanVote, percentPeopleDissatisfied, standardEffectiveTemperature, port_2, comfortableOrNot, percentOfTimeComfortable, port_3, balanceTemperature; plug-in component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
strategylist = Ladybug_PassiveStrategyList({"Evaporative Cooling", "Thermal Mass + Night Vent", "Occupant Use of Fans", "Internal Heat Gain", "Dessicant Dehumidification", "Dehumidification Only", "Humidification Only"}, selected=["Occupant Use of Fans", "Internal Heat Gain", "Dehumidification Only"])
panel_8 = Panel(pmvcomfortcalculator.standardEffectiveTemperature)
adaptivecomfortcalculator = Ladybug_AdaptiveComfortCalculator(
    dryBulbTemperature=importepw_3.dryBulbTemperature,
    prevailingOutdoorTemp=importepw_3.dryBulbTemperature,
    runIt=Toggle(True))  # -> readMe, port, comfortableOrNot, conditionOfPerson, degreesFromTarget, port_2, targetTemperature, upperTemperatureBound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; plug-in component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
panel_9 = Panel(adaptivecomfortcalculator.conditionOfPerson)
windrose = Ladybug_WindRose(
    north=0,
    hourlyWindDirection=importepw_3.windDirection,
    hourlyWindSpeed=importepw_3.windSpeed,
    annualHourlyData=flatten(adaptivecomfortcalculator.conditionOfPerson),
    conditionalStatement="b==0",
    runIt=Toggle(False))  # -> readMe, calmRoseMesh, windRoseMesh, windRoseCrvs, windRoseCenPts, legend, legendBasePts, title; plug-in component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
